# Grasshopper definition unnamed.gh (Grasshopper 1.0.7)

number_slider = Slider(-1, range=-1..0)
c_script = CSharpScript(Run=Toggle(True), Reset=Button(), Iterations=Slider(10, range=0..10))  # -> A; inputs Run: Boolean, Reset: Boolean, Iterations: Int32
# ---------- c_script: C# ----------
    if (Iterations != _maximum)
    {
      _maximum = Iterations;
      _counter = Iterations;
    }
    A = _maximum - _counter;

    _run = Run;
    if (_counter == 0)
      _run = false;

    if (_run)
      GrasshopperDocument.ScheduleSolution(100, ScheduleCallback);

    if (Reset){
      _counter = Iterations;
    }
# ---------- c_script: C# additional code ----------
  private int _maximum = -1;
  private int _counter = -1;
  private bool _run = false;

  private void ScheduleCallback(GH_Document document)
  {
    _counter--;
    Component.ExpireSolution(false);
  }
# ---------- end c_script ----------
panel = Panel(c_script)
